# Grasshopper definition ripple.gh (Grasshopper 1.0.7)
# plug-ins: FirstComponentTest, Weaverbird, Kangaroo2 Components

md_slider = MDSlider(SliderMode=0, slider_value=Point(0.5, 0.5, 0.5), x_domain=Domain(0, 1), y_domain=Domain(0, 1), z_domain=Domain(0, 1))
number_slider = Slider(6, range=0..10)
number_slider_2 = Slider(0.001, range=0..0.001)
number_slider_3 = Slider(0.3, range=0..1)
number_slider_4 = Slider(1e-06, range=0..1e-06)
series = Series(Start=Slider(5, range=0..10), Step=1, Count=number_slider)
series_2 = Series(Start=0, Step=1, Count=number_slider)
msphere = MeshSphere(Base=PlaneXY(0, 0, 0), Radius=10, UCount=10, VCount=20)
scale = Scale(Geometry=msphere, Center=Point(0, 0, 0), Factor=Slider(45, range=0..100))  # -> Geometry, Transform
pt = ConstructPoint(XCoordinate=series, YCoordinate=series_2, ZCoordinate=0)
pop3d = Populate3D(Region=scale.Geometry, Count=Slider(4, range=0..10), Seed=Slider(3341865.078, range=0..10000000))
clean = CombineClean(Meshes=msphere)
pt_2 = Point(Point(50, 32, 0))
meshcp = MeshClosestPoint(Point=md_slider, Mesh=msphere)  # -> Point, Index, Parameter
wbloop = WeaverbirdsLoopSubdivision(MeshCurves=msphere, Level=Slider(1, range=0..10), SmoothNakedEdges=1)
meshrip = MeshRipple(Mesh=wbloop, AttractorPoints=pop3d, DispDistance=Slider(1, range=0..10), Iterations=Slider(4, range=0..30))  # -> Mesh, DispValues, P
demesh = DeconstructMesh(Mesh=[wbloop, meshrip.Mesh])  # -> Vertices, Faces, Colours, Normals
mesh = Mesh(meshrip.Mesh)
flip = FlipMatrix(Data=simplify(demesh.Vertices))
item = ListItem(List=flip, Index=0, Wrap=True)  # -> Item, Item1
preview = CustomPreview(
    Geometry=mesh,
    Material={diffuse=RGB(221, 160, 221), emission=RGB(66, 48, 66), shine=0.5, specular=RGB(255, 255, 255), transparency=0})
dist = Distance(PointA=item.Item, PointB=item.Item1)  # -> flatten(Distance)
panel = Panel(dist)
